# Grasshopper definition H_MeshPreprocessing.gh (Grasshopper 1.0.7)
# plug-ins: Weaverbird, MeshEdit Components, Pufferfish

crv = Curve(<curve referenced from the Rhino model>)
mesh = Mesh([<mesh referenced from the Rhino model> x5])

# ---- group: Might not need it anymore
# consistent 5mm offset from setoff line
# might not need it anymore
crv_2 = Curve(<curve referenced from the Rhino model>)  # disabled

# ----
chopping_height = Slider(10, range=0..100)
scannedmesh = GetGeometry(mesh, AtLeast=1, AtMost=2147483647, Filter=1074004029)
divisionline = GetGeometry(crv, AtLeast=1, AtMost=2147483647, Filter=1074004029)

# ---- group: Might not need it anymore / NEED to retire this / Ensure Start is Top Point
end = EndPoints(Curve=crv_2)  # -> Start, End; disabled
geo = Geometry([end.Start, end.End])  # disabled
pdecon = Deconstruct(Point=geo)  # -> XComponent, YComponent, ZComponent; disabled
item = ListItem(List=pdecon.ZComponent, Index=0, Wrap=True)  # -> Item, Item1; disabled
larger = LargerThan(FirstNumber=item.Item1, SecondNumber=item.Item)  # -> LargerThan, OrEqualTo; disabled
flip = FlipCurve(Curve=crv_2)  # -> Curve, Flag; disabled
filter = StreamFilter(Gate=larger.LargerThan, Stream0=crv_2, Stream1=flip.Curve)  # disabled
panel = Panel(larger.LargerThan)  # disabled

# ----
groundchoppingheight = GetNumber(chopping_height, AtLeast=1, AtMost=2147483647, Maximum=1.797693135e+308, Minimum=-1.797693135e+308)

# ---- group: Might not need it anymore / NEED to retire this
crv_3 = Curve(filter)  # disabled

# ----
number_slider = Slider(100, range=0..100)
ext = ExtendCurve(Curve=divisionline, Type=0, Start=number_slider, End=number_slider)

# ---- group: removing ground
mjoin = MeshJoin(Meshes=scannedmesh)

wbloop = WeaverbirdsLoopSubdivision(MeshCurves=mjoin, Level=Slider(1, range=0..10), SmoothNakedEdges=1)

disjoint = DisjointMesh(Mesh=wbloop)
item_2 = ListItem(List=disjoint, Index=0, Wrap=True)
area = MeshArea(Mesh=item_2)  # -> Area, Centroid
sort = SortList(Keys=area.Area, ValuesA=item_2)  # -> Keys, ValuesA

# Wil need extra steps to clean up bigger scanned mesh
item_3 = ListItem(List=reverse(sort.ValuesA), Index=0, Wrap=True)

bbox = BoundingBox(Content=item_3, Plane=PlaneXY(0, 0, 0))  # -> Box, Box_2
debox = DeconstructBox(Box=bbox.Box)  # -> Plane, X, Y, Z
dedomain = DeconstructDomain(Domain=debox.Z)  # -> Start, End
abs = Absolute(Value=dedomain.Start)
addition = Addition(A=abs, B=groundchoppingheight)
Z = UnitZ(Factor=addition)
move = Move(Geometry=bbox.Box, Motion=Z)  # -> Geometry, Transform
mbox = MeshBox(Base=move.Geometry, XCount=10, YCount=10, ZCount=10)
tri = Triangulate(Mesh=mbox)  # -> Mesh, Count

msplit = MeshSplit(Mesh=item_3, Splitters=tri.Mesh)

area_2 = MeshArea(Mesh=msplit)  # -> Area, Centroid
pdecon_2 = Deconstruct(Point=area_2.Centroid)  # -> XComponent, YComponent, ZComponent
sort_2 = SortList(Keys=pdecon_2.ZComponent, ValuesA=msplit)  # -> Keys, ValuesA
item_4 = ListItem(List=reverse(sort_2.ValuesA), Index=0, Wrap=True)

# ---- group: Get Top Height
debox_2 = DeconstructBox(Box=mbox)  # -> Plane, X, Y, Z
num = Number(debox_2.Z)

# ----
mesh_2 = Mesh(item_4)

project = Project(Geometry=mesh_2, Plane=PlaneXY(0, 0, 0))  # -> Geometry, Transform
demesh = DeconstructMesh(Mesh=project.Geometry)  # -> flatten(Vertices), Faces, Colours, Normals
cullpt = CullDuplicates(Points=demesh.Vertices, Tolerance=0.1, CullMode=1)  # -> Points, Indices, Valence
del = DelaunayMesh(Points=cullpt.Points, Plane=PlaneXY(0, 0, 0))
wbnaked = WeaverbirdsNakedBoundary(MeshClosedPolylines=del)
Z_2 = UnitZ(Factor=num)
move_2 = Move(Geometry=wbnaked, Motion=Z_2)  # -> Geometry, Transform
srf = Surface(move_2.Geometry)

facen = FaceNormals(Mesh=mesh_2)  # -> Centers, Normals

xy = XYPlane(Origin=Point(0, 0, 0))
Z_3 = UnitZ(Factor=num)
move_3 = Move(Geometry=xy, Motion=Z_3)  # -> Geometry, Transform

# ---- group: Checking Lines
srf_cp = SurfaceClosestPoint(Point=facen.Centers, Surface=srf)  # -> Point, UVPoint, Distance
ln = Line(StartPoint=facen.Centers, EndPoint=srf_cp.Point)

# ----
project_2 = Project(Geometry=ext, Plane=move_3.Geometry)  # -> Geometry, Transform

# ---- group: Checking Lines
ext_2 = ExtendCurve(Curve=ln, Type=0, Start=Slider(-1, range=-1..0), End=Slider(0, range=0..100))

# ---- group: Check if line 'pierce' through top face
mcx = MeshCurve(Mesh=mesh_2, Curve=ext_2)  # -> simplify(Points), Faces

item_5 = ListItem(List=mcx.Points, Index=0, Wrap=True)
bool = Boolean(item_5)
nullrep = ReplaceNulls(Items=bool, Replacements=Toggle(False))  # -> flatten(Items), Count

# ---- group: Splitter
project_3 = Project(Geometry=project_2.Geometry, Plane=PlaneXY(0, 0, 0))  # -> Geometry, Transform
loft = Loft(
    Curves=[project_2.Geometry, project_3.Geometry],
    Options={Adjust=False, Closed=False, LoftEnds=0, LoftSimp=0, LoftType=0, Rebuild=10, Refit=0.01})
mesh_3 = MeshBrep(
    Brep=loft,
    Settings={GridMaxCount=0, GridMinCount=16, JaggedSeams=False, MaxEdgeLength=0, MinEdgeLength=0.0001, MinTolerance=0, Refine=True, RefineAngle=0, RelativeTolerance=0.65, SimplePlanes=True, Tolerance=0})

# ----
cullf = CullFaces(Mesh=mesh_2, Pattern=nullrep.Items)
msplit_2 = MeshSplit(Mesh=cullf, Splitters=mesh_3)

wbnaked_2 = WeaverbirdsNakedBoundary(MeshClosedPolylines=cullf)
join = JoinCurves(Curves=wbnaked_2, Preserve=False)
len = Length(Curve=join)
sort_3 = SortList(Keys=len, ValuesA=join)  # -> Keys, ValuesA
item_6 = ListItem(List=reverse(sort_3.ValuesA), Index=0, Wrap=True)

mmx = MeshMesh(MeshA=cullf, MeshB=mesh_3)
join_2 = JoinCurves(Curves=mmx, Preserve=False)

area_3 = MeshArea(Mesh=msplit_2)  # -> Area, Centroid
sort_4 = SortList(Keys=area_3.Area, ValuesA=msplit_2)  # -> Keys, ValuesA
item_7 = ListItem(List=sort_4.ValuesA, Index=0, Wrap=True)

# ----
# Always maintain start at right (welding will
# start right to left, clockwise
crv_4 = Curve(join_2)
end_2 = EndPoints(Curve=crv_4)  # -> Start, End
pdecon_3 = Deconstruct(Point=end_2.Start)  # -> XComponent, YComponent, ZComponent
pdecon_4 = Deconstruct(Point=end_2.End)  # -> XComponent, YComponent, ZComponent
larger_2 = LargerThan(FirstNumber=pdecon_4.XComponent, SecondNumber=pdecon_3.XComponent)  # -> LargerThan, OrEqualTo
flip_2 = FlipCurve(Curve=crv_4)  # -> Curve, Flag
filter_2 = StreamFilter(Gate=larger_2.LargerThan, Stream0=crv_4, Stream1=flip_2.Curve)

# ---- group: RH_OUT:InnerBoundaryCrv
crv_5 = Curve(filter_2)

# ---- group: RH_OUT:WeldingZone
geo_2 = Geometry(item_7)

# ----
clscrv = CloseCurve(Curve=item_6, CloseType=0, Bulge=0.5, Tolerance=0)  # -> Closed, R

mcx_2 = MeshCurve(Mesh=mesh_3, Curve=reparameterize(clscrv.Closed))  # -> Points, Faces
crv_cp = CurveClosestPoint(Point=mcx_2.Points, Curve=reparameterize(clscrv.Closed))  # -> Point, Parameter, Distance

shatter = Shatter(Curve=reparameterize(clscrv.Closed), Parameters=crv_cp.Parameter)

curvepoint = PointOnCurve(shatter, parameter=0.5)
meshcp = MeshClosestPoint(Point=curvepoint, Mesh=mesh_3)  # -> Point, Index, Parameter
dist = Distance(PointA=curvepoint, PointB=meshcp.Point)
sort_5 = SortList(Keys=dist, ValuesA=shatter)  # -> Keys, ValuesA
item_8 = ListItem(List=sort_5.ValuesA, Index=0, Wrap=True)

smoothpline = SmoothPolyline(Polyline=item_8, Strength=1, Times=Slider(10, range=0..10))

# ---- group: RH_OUT:OuterBoundaryCrv
crv_6 = Curve(smoothpline)
