# Grasshopper definition H_SpaceOutCrvsUsingKangaroo.gh (Grasshopper 1.0.7)
# plug-ins: Kangaroo2 Components, Weaverbird, Pufferfish

mesh = Mesh(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)
crv = Curve(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)
geo = Geometry([Line((605.6550695, 694.4583231, 268.355327), (866.5273834, 1121.009183, 268.355327)), Line((609.7430602, 691.9581674, 266.9817404), (870.6153741, 1118.509027, 266.9817404)), Line((613.6116264, 689.5922084, 264.8759392), (874.4839403, 1116.143068, 264.8759392)), Line((617.4834165, 687.2242778, 262.783111), (878.3557303, 1113.775137, 262.783111)), Line((621.4503209, 684.7981767, 260.9550484), (882.3226348, 1111.349036, 260.9550484)), Line((625.2007192, 682.2077988, 258.9034593), (913.9573469, 1090.398453, 258.9034593))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])
outerboundary = GetGeometry(crv, AtLeast=1, AtMost=2147483647, Filter=1074004029)
iraycurves = GetGeometry(geo, AtLeast=1, AtMost=2147483647, Filter=1074004029)
imesh = GetGeometry(mesh, AtLeast=1, AtMost=2147483647, Filter=1074004029)
targetgap = GetNumber(Slider(5, range=0..10), AtLeast=1, AtMost=2147483647, Maximum=1.797693135e+308, Minimum=-1.797693135e+308)

project = Project(Geometry=outerboundary, Plane=PlaneXY(0, 0, 0))  # -> Geometry, Transform

project_2 = Project(Geometry=iraycurves, Plane=PlaneXY(0, 0, 0))  # -> simplify(Geometry), Transform
item = ListItem(List=project_2.Geometry, Index=0, Wrap=True)  # -> Item1, Item
series = Series(Start=0, Step=targetgap, Count="30")
offset = OffsetCurve(Curve=item.Item, Distance=expr("-x", series), Corners=1)  # -> flatten(Curve)
offset_2 = OffsetCurve(Curve=item.Item1, Distance=series, Corners=1)  # -> flatten(Curve)
cull_i = CullIndex(List=offset, Indices="0", Wrap=True)
cull_i_2 = CullIndex(List=offset_2, Indices="0", Wrap=True)
rev = ReverseList(List=cull_i)
merge = Merge(Data1=flatten(rev), Data2=flatten(project_2.Geometry), Data3=flatten(cull_i_2))

# ----
# Add more lines on both ends to cover
# entire region of welding
# 
# 1)check if offset is always on the correct
# direction for future curves
# 2)highly dependable on inner boundary
# direction
project_3 = Project(Geometry=imesh, Plane=PlaneXY(0, 0, 0))  # -> Geometry, Transform
ccx = CurveCurve(CurveA=reparameterize(project.Geometry), CurveB=reparameterize(merge))  # -> simplify(Points), simplify(ParamsA), simplify(ParamsB)

wbnaked = WeaverbirdsNakedBoundary(MeshClosedPolylines=project_3.Geometry)
join = JoinCurves(Curves=wbnaked, Preserve=False)

len = Length(Curve=join)
sort = SortList(Keys=len, ValuesA=join)  # -> Keys, ValuesA
item_2 = ListItem(List=reverse(sort.ValuesA), Index=0, Wrap=True)
clscrv = CloseCurve(Curve=item_2, CloseType=0, Bulge=0.5, Tolerance=0)  # -> Closed, R

shatter = Shatter(Curve=reparameterize(graft(merge)), Parameters=ccx.ParamsB)  # -> simplify(Segments)
curvepoint = PointOnCurve(shatter, parameter=0.5)
incurve = PointInCurve(Point=curvepoint, Curve=clscrv.Closed)  # -> Relationship, Point

cull = CullPattern(List=shatter, CullPattern=incurve.Relationship)

join_2 = JoinCurves(Curves=cull, Preserve=False)  # -> simplify(Curves)
end = EndPoints(Curve=join_2)  # -> Start, End
ln = Line(StartPoint=end.Start, EndPoint=end.End)

toggle = BooleanToggle(True)
clean = CleanTree(RemoveNulls=toggle, RemoveInvalid=toggle, RemoveEmpty=toggle, Tree=ln)  # -> simplify(flatten(Tree))

graft = GraftTree(Tree=clean, IncludeEmptyLists=True, IncludeNullItems=True)  # -> simplify(Tree)
# Space out welding path dynamically using K2.
# Startpt is anchored, endPt is allowed to 'slide' along user defined boundary and
#  is spacing out with neighbouring curve using 'Length' & 'Sphere Collide' in K2.
# Strength needs to be fine tuned for robust performance.
end_2 = EndPoints(Curve=graft)  # -> Start, End
geo_2 = Geometry(flatten(end_2.End))
shift = ShiftList(List=geo_2, Shift=1, Wrap=False)
ln_2 = Line(StartPoint=geo_2, EndPoint=shift)

toggle_2 = BooleanToggle(True)
clean_2 = CleanTree(RemoveNulls=toggle_2, RemoveInvalid=toggle_2, RemoveEmpty=toggle_2, Tree=ln_2)

sc = SphereCollide(Points=geo_2, Radius=expr("x/2", targetgap), Strength=1)
oncurve = OnCurve(Points=flatten(geo_2), Curve=project.Geometry, Strength=Slider(5, range=0..10))
anchor = Anchor(Point=flatten(end_2.Start), Strength="500")
length_line = LengthLine(Line=flatten(graft), Strength=10)
length_line_2 = LengthLine(Line=clean_2, Length=targetgap, Strength=Slider(100, range=0..100))
show = Show(G=flatten(graft))
entwine = Entwine(
    Branch00=show,
    Branch01=anchor,
    Branch02=sc,
    Branch03=oncurve,
    Branch04=length_line,
    Branch05=length_line_2,
    FlattenInputs=True)  # -> simplify(Result)

toggle_3 = BooleanToggle(False)  # disabled
button = Button()  # disabled
solver = Solver(GoalObjects=simplify(entwine), Reset=button, Threshold=1e-15, Tolerance=0.0001, On=toggle_3)  # -> I, V, O; disabled

zombiesolver = ZombieSolver(GoalObjects=entwine, Threshold=1e-10, Tolerance=0.0001, MaxIterations=50000)  # -> I, V, O

lng = ListLength(List=show)
series_2 = Series(Start=0, Step=1, Count=lng)

item_3 = ListItem(List=zombiesolver.O, Index=series_2, Wrap=True)

end_3 = EndPoints(Curve=simplify(item_3))  # -> Start, End
shift_2 = ShiftList(List=end_3.End, Shift=1, Wrap=False)
dist = Distance(PointA=end_3.End, PointB=shift_2)
bnd = Bounds(Numbers=dist)  # -> simplify(Domain)
panel = Panel(bnd)

# ---- group: RH_OUT:Bounds
txt = Text(bnd)

# ---- group: RH_OUT:oCurves
crv_2 = Curve(item_3)
