# Grasshopper definition Propeller_Main.gh (Grasshopper 1.0.7)
# plug-ins: Hops

panel = Panel("C:\0_Zijie\Current_cmdR\2_Mencast\")

# ---- group: Scanned Mesh
mesh = Mesh([<mesh referenced from the Rhino model> x5])

# ---- group: Input Division Curve
crv = Curve(<curve referenced from the Rhino model>)

# ----
# Get welding Zone
panel_2 = Panel("Project Folder\0_Hops\H_MeshPreprocessing.gh")
concat = Concatenate(FragmentA=panel, FragmentB=panel_2)

hops = Hops(
    _Path=concat,
    GroundChoppingHeight=Slider(10, range=0..10),
    ScannedMesh=mesh,
    DivisionLine=crv,
    CacheResultsInMemory=True,
    CacheSolveResults=True,
    RemoteDefinitionLocation="C:\0_Zijie\Current_cmdR\2_Mencast\Project Folder\0_Hops\H_MeshPreprocessing.gh",
    RemoteSolveVersion=(0, 1, 0),
    ShowInput_Enabled=False,
    ShowInput_Path=True,
    SynchronousSolve=True)  # -> OuterBoundaryCrv, InnerBoundaryCrv, WeldingZone

mesh_2 = Mesh(hops.WeldingZone)
targetgap = Slider(5, range=1..8)

# ----
# 1)Project Ray from inside Crv by Dist
c_script = CSharpScript(iMesh=mesh_2, iCrv=hops.InnerBoundaryCrv, iDiv=targetgap)  # -> out, oRayCurves; inputs iMesh: Mesh, iCrv: Curve, iDiv: Double
# ---------- c_script: C# ----------
    //List
    List<Point3d> pts = new List<Point3d>();
    List<Line> crvs = new List<Line>();
    
    //reparameterise curve
    iCrv.Domain = new Interval(0, 1);

    //get param of crv
    double[] param = iCrv.DivideByLength(iDiv, false);

    //draw rays from point
    foreach(double x in param){
      Point3d pt = iCrv.PointAt(x);
      pts.Add(pt);
      var meshPt = iMesh.ClosestMeshPoint(pt, 10);
      //Vector3d normalOnMesh = iMesh.NormalAt(meshPt);
      Vector3d tangent = iCrv.TangentAt(x);
      Vector3d dir = Vector3d.CrossProduct(Plane.WorldXY.ZAxis, tangent);
      Line crv = new Line(pt, dir, 500);
      crvs.Add(crv);
    }

    oRayCurves = crvs;
# ---------- end c_script ----------

# ---- group: Test Hop for c# code
geo = Geometry(hops.WeldingZone)
geo_2 = Geometry(c_script.oRayCurves)
hops_2 = Hops(
    Mesh=geo,
    Crvs=geo_2,
    Count=Slider(7, range=0..10),
    Dist=Slider(5, range=0..10),
    CacheResultsInMemory=False,
    CacheSolveResults=False,
    RemoteDefinitionLocation="C:\0_Zijie\Current_cmdR\2_Mencast\0_WIP\Propeller_WorkingSrf\H_Test.gh",
    RemoteSolveVersion=(0, 1, 0),
    ShowInput_Enabled=False,
    ShowInput_Path=False,
    SynchronousSolve=True)  # disabled

# ----
geo_3 = Geometry(c_script.oRayCurves)

concat_2 = Concatenate(FragmentA=panel, FragmentB="Project Folder\0_Hops\H_SpaceOutCrvsUsingKangaroo.gh")

# ----
# 1)Space out Welding Path using K2
hops_3 = Hops(
    _Path=concat_2,
    OuterBoundary=hops.OuterBoundaryCrv,
    TargetGap=targetgap,
    IMesh=mesh_2,
    IRayCurves=geo_3,
    CacheResultsInMemory=False,
    CacheSolveResults=False,
    RemoteDefinitionLocation="C:\0_Zijie\Current_cmdR\2_Mencast\Project Folder\0_Hops\H_SpaceOutCrvsUsingKangaroo.gh",
    RemoteSolveVersion=(0, 1, 0),
    ShowInput_Enabled=False,
    ShowInput_Path=True,
    SynchronousSolve=True)  # -> OCurves, Bounds

panel_3 = Panel(hops_3.Bounds)
geo_4 = Geometry(hops_3.OCurves)

# ----
# 1)Trim overlapping Curve
# 2)Project to Mesh
c_script_2 = CSharpScript(iCurves=geo_4, iMesh=mesh_2)  # -> out, oCurvesTrimmed, oPlanes, oCurvesProjectedToMesh; inputs iCurves: list of Curve, iMesh: Mesh
# ---------- c_script_2: C# ----------
    //use global tolerance from rhino
    //var tol = RhinoDoc.ActiveDoc.ModelAbsoluteTolerance;
    double tol = 0.001;

    List<Curve> flattenedCrv = new List<Curve>();
    List<Curve> goodCrv = new List<Curve>();
    DataTree<Plane> goodCrvPlane = new DataTree<Plane>();


    //flatten all curves
    for(int i = 0; i < iCurves.Count; i++){
      iCurves[i].Domain = new Interval(0, 1);
      flattenedCrv.Add(Curve.ProjectToPlane(iCurves[i], Plane.WorldXY));
    }

    for(int i = 0; i < flattenedCrv.Count; i++)
    {
      //create planes with line
      Line XDir = new Line(iCurves[i].PointAtStart, iCurves[i].PointAtEnd);
      Vector3d xAxis = XDir.Direction;
      Plane plane = new Plane(iCurves[i].PointAtStart, xAxis, Plane.WorldXY.ZAxis);
      //goodCrvPlane.Add(plane);
      goodCrvPlane.Add(plane, new GH_Path(i));

      if(i == 0){
        goodCrv.Add(flattenedCrv[0]);
      }

      else
      {
        int counter = 0;
        List<int> index = new List<int>();
        int j = goodCrv.Count - 1;

        while(j >= 0)
        {
          if(Curve.PlanarCurveCollision(flattenedCrv[i], goodCrv[j], Plane.WorldXY, tol)){
            counter += 1;
            index.Add(j);
          }
          j--;
        }


        Print("{0}", counter);
        if( counter > 0)
        {
          goodCrv.Add(TrimCrv(flattenedCrv[i], goodCrv[index[0]]));
        }

        else
        {
          goodCrv.Add(flattenedCrv[i]);
        }
      }
    }

    DataTree<Curve> ProjectedCrvs = new DataTree<Curve>();

    for(int i = 0; i < goodCrv.Count; i++){
      Curve[] crv = Curve.ProjectToMesh(goodCrv[i], iMesh, Plane.WorldXY.ZAxis * -1, tol);
      ProjectedCrvs.AddRange(crv, new GH_Path(i));
    }


    oCurvesTrimmed = goodCrv;
    oPlanes = goodCrvPlane;
    oCurvesProjectedToMesh = ProjectedCrvs;
# ---------- c_script_2: C# additional code ----------
  public Curve TrimCrv(Curve CrvToTrim, Curve TrimmingCrv){
    CrvToTrim.Domain = new Interval(0, 1);
    TrimmingCrv.Domain = new Interval(0, 1);
    //var tol = RhinoDoc.ActiveDoc.ModelAbsoluteTolerance;
    double tol = 0.001;

    var intersectPts = Rhino.Geometry.Intersect.Intersection.CurveCurve(CrvToTrim, TrimmingCrv, tol, tol);

    Curve trimmedCrv = CrvToTrim.Trim(new Interval(0, intersectPts[0].ParameterA));
    return trimmedCrv;
  }
# ---------- end c_script_2 ----------

rebuild_division_point_distance = Slider(5, range=0..10)
geo_5 = Geometry(c_script_2.oCurvesProjectedToMesh)

# ---- group: WIP: Clean up first line of offset using projected crv
# Welding Path 2
number_slider = Slider(10, range=0..30)
idist = Slider(5, range=0..10)
c_script_3 = CSharpScript(iMesh=mesh_2, iCurve=hops.InnerBoundaryCrv, iCount=number_slider, iDist=idist)  # -> out, oCurves; inputs iMesh: Mesh, iCurve: Curve, iCount: Int32, iDist: Double
# ---------- c_script_3: C# ----------
    List<Curve> allCrvs = new List<Curve>();

    for(int i = 0; i < iCount; i++){
      if(i == 0){
        allCrvs.Add(OffsetCurve(iCurve, iMesh, iDist));}

      else {
        allCrvs.Add(OffsetCurve(allCrvs[i - 1], iMesh, iDist));}
    }


    oCurves = allCrvs;
# ---------- c_script_3: C# additional code ----------
  public Curve OffsetCurve(Curve crv, Mesh mesh, double dist){

    //project crv onto Mesh in neg Z direction
    //var tol = RhinoDoc.ActiveDoc.ModelAbsoluteTolerance;
    double tol = 0.001;
    Curve.ProjectToMesh(crv, mesh, Plane.WorldXY.ZAxis * -1, tol);

    Point3d[] points = crv.DivideEquidistant(10);
    points = mesh.PullPointsToMesh(points);
    Curve newCrv = Rhino.Geometry.Curve.CreateInterpolatedCurve(points, 3);
    newCrv.Domain = new Interval(0, 1);

    //List<Vector3d> tangents = new List<Vector3d>();
    //List<Vector3d> dirs = new List<Vector3d>();
    List<Point3d> MovedPts = new List<Point3d>();


    for(int i = 0; i < points.Length; i++){
      double param;
      Point3d pt;
      Vector3d normal;

      newCrv.ClosestPoint(points[i], out param);
      Vector3d tangent = newCrv.TangentAt(param);

      mesh.ClosestPoint(points[i], out pt, out normal, 10);
      Vector3d dir = Vector3d.CrossProduct(normal, tangent);
      dir.Unitize();
      Vector3d move = dir * dist;
      Point3d moved = Point3d.Add(move, points[i]);

      //tangents.Add(tangent);
      //dirs.Add(dir);
      MovedPts.Add(moved);
    }


    Curve offsetCrv = Rhino.Geometry.Curve.CreateInterpolatedCurve(MovedPts, 3);
    return offsetCrv;
  }
# ---------- end c_script_3 ----------

# ----
geo_6 = Geometry(c_script_3.oCurves)

weldingoptions = Slider(1, range=0..1)
panel_4 = Panel("""0 = horizontal
1 = perpendicular""")

# ----
# 1)Connecting Disjoint Curve segments
# after projecting (if any)
# 2) rebuild welding curve with standard division pt
c_script_4 = CSharpScript(iCurves=geo_5)  # -> out, oSingle, oMultiple, oIndex; inputs iCurves: tree of Curve
# ---------- c_script_4: C# ----------
    DataTree<Curve> segmentedCrvs = new DataTree<Curve>();
    DataTree<Curve> singleCrvs = new DataTree<Curve>();
    List<int> index = new List<int>();

    for(int i = 0; i < iCurves.BranchCount; i++)
    {
      if(iCurves.Branch(i).Count > 1){
        segmentedCrvs.AddRange(iCurves.Branch(i), new GH_Path(i));
        index.Add(i);
      }
      else{
        singleCrvs.AddRange(iCurves.Branch(i), new GH_Path(i));
      }

    }

    oSingle = singleCrvs;
    oMultiple = segmentedCrvs;
    oIndex = index;
# ---------- end c_script_4 ----------

branch = TreeBranch(Tree=simplify(graft(c_script_2.oCurvesTrimmed)), Path=c_script_4.oIndex, MaintainPaths=True)
ext = ExtendCurve(Curve=branch, Type=0, Start="0", End="200")

# ----
# Welding Path 1
divdist = DivideDistance(Curve=simplify(c_script_4.oMultiple), Distance=rebuild_division_point_distance)  # -> simplify(Points), Tangents, Parameters
path_mapper = PathMapper(divdist.Points, source="{A;B}(i)", target="{A}")
alongcrv = SortAlongCurve(Points=path_mapper, Curve=ext)  # -> simplify(Points), Indices
intcrv = Interpolate(Vertices=alongcrv.Points, Degree=3, Periodic=False, KnotStyle=1)  # -> Curve, Length, Domain

merge = Merge(Data1=c_script_4.oSingle, Data2=intcrv.Curve)  # -> simplify(Result)

geo_7 = Geometry(merge)
filter = StreamFilter(Gate=weldingoptions, Stream0=geo_6, Stream1=geo_7)
