# Grasshopper definition Propeller_MeshPreprocessing.gh (Grasshopper 1.0.7)
# plug-ins: Weaverbird, MeshEdit Components, Pufferfish

crv = Curve(<curve referenced from the Rhino model>)
crv_2 = Curve(<curve referenced from the Rhino model>)
mesh = Mesh([<mesh referenced from the Rhino model> x5])

chopping_height = Slider(10, range=0..100)
crv_3 = Curve(crv_2)

# ---- group: Splitter
number_slider = Slider(50, range=0..100)
ext = ExtendCurve(Curve=crv_3, Type=0, Start=number_slider, End=number_slider)
project = Project(Geometry=ext, Plane=PlaneXY(0, 0, 0))  # -> Geometry, Transform
loft = Loft(
    Curves=[ext, project.Geometry],
    Options={Adjust=False, Closed=False, LoftEnds=0, LoftSimp=0, LoftType=0, Rebuild=10, Refit=0.01})
mesh_2 = MeshBrep(
    Brep=loft,
    Settings={GridMaxCount=0, GridMinCount=16, JaggedSeams=False, MaxEdgeLength=0, MinEdgeLength=0.0001, MinTolerance=0, Refine=True, RefineAngle=0, RelativeTolerance=0.65, SimplePlanes=True, Tolerance=0})

# ---- group: NEED to retire this / Ensure Start is Top Point
end = EndPoints(Curve=crv)  # -> Start, End
geo = Geometry([end.Start, end.End])
pdecon = Deconstruct(Point=geo)  # -> XComponent, YComponent, ZComponent
item = ListItem(List=pdecon.ZComponent, Index=0, Wrap=True)  # -> Item, Item1
larger = LargerThan(FirstNumber=item.Item1, SecondNumber=item.Item)  # -> LargerThan, OrEqualTo
flip = FlipCurve(Curve=crv)  # -> Curve, Flag
filter = StreamFilter(Gate=larger.LargerThan, Stream0=crv, Stream1=flip.Curve)
panel = Panel(larger.LargerThan)

# ---- group: NEED to retire this
crv_4 = Curve(filter)

# ---- group: removing ground
mjoin = MeshJoin(Meshes=mesh)

# ----
wbloop = WeaverbirdsLoopSubdivision(MeshCurves=mjoin, Level=Slider(1, range=0..10), SmoothNakedEdges=1)

# ---- group: removing ground (continued)
disjoint = DisjointMesh(Mesh=wbloop)
item_2 = ListItem(List=disjoint, Index=0, Wrap=True)
area = MeshArea(Mesh=item_2)  # -> Area, Centroid
sort = SortList(Keys=area.Area, ValuesA=item_2)  # -> Keys, ValuesA

item_3 = ListItem(List=reverse(sort.ValuesA), Index=0, Wrap=True)

bbox = BoundingBox(Content=item_3, Plane=PlaneXY(0, 0, 0))  # -> Box, Box_2
debox = DeconstructBox(Box=bbox.Box)  # -> Plane, X, Y, Z
dedomain = DeconstructDomain(Domain=debox.Z)  # -> Start, End
abs = Absolute(Value=dedomain.Start)
addition = Addition(A=abs, B=chopping_height)
Z = UnitZ(Factor=addition)
move = Move(Geometry=bbox.Box, Motion=Z)  # -> Geometry, Transform
mbox = MeshBox(Base=move.Geometry, XCount=10, YCount=10, ZCount=10)
tri = Triangulate(Mesh=mbox)  # -> Mesh, Count

msplit = MeshSplit(Mesh=item_3, Splitters=tri.Mesh)

area_2 = MeshArea(Mesh=msplit)  # -> Area, Centroid
pdecon_2 = Deconstruct(Point=area_2.Centroid)  # -> XComponent, YComponent, ZComponent
sort_2 = SortList(Keys=pdecon_2.ZComponent, ValuesA=msplit)  # -> Keys, ValuesA
item_4 = ListItem(List=reverse(sort_2.ValuesA), Index=0, Wrap=True)

# ----
facen = FaceNormals(Mesh=item_4)  # -> Centers, Normals
mesh_3 = Mesh(item_4)

project_2 = Project(Geometry=mesh_3, Plane=PlaneXY(0, 0, 0))  # -> Geometry, Transform
demesh = DeconstructMesh(Mesh=project_2.Geometry)  # -> flatten(Vertices), Faces, Colours, Normals
cullpt = CullDuplicates(Points=demesh.Vertices, Tolerance=0.1, CullMode=1)  # -> Points, Indices, Valence
del = DelaunayMesh(Points=cullpt.Points, Plane=PlaneXY(0, 0, 0))
wbnaked = WeaverbirdsNakedBoundary(MeshClosedPolylines=del)
Z_2 = UnitZ(Factor=Slider(381, range=0..1000))
move_2 = Move(Geometry=wbnaked, Motion=Z_2)  # -> Geometry, Transform
srf = Surface(move_2.Geometry)

# ---- group: Checking Lines
srf_cp = SurfaceClosestPoint(Point=facen.Centers, Surface=srf)  # -> Point, UVPoint, Distance
ln = Line(StartPoint=facen.Centers, EndPoint=srf_cp.Point)

ext_2 = ExtendCurve(Curve=ln, Type=0, Start=Slider(-1, range=-1..0), End=Slider(0, range=0..100))

# ---- group: Check if line 'pierce' through top face
mcx = MeshCurve(Mesh=mesh_3, Curve=ext_2)  # -> simplify(Points), Faces

item_5 = ListItem(List=mcx.Points, Index=0, Wrap=True)
bool = Boolean(item_5)
nullrep = ReplaceNulls(Items=bool, Replacements=Toggle(False))  # -> flatten(Items), Count

# ----
cullf = CullFaces(Mesh=mesh_3, Pattern=nullrep.Items)
msplit_2 = MeshSplit(Mesh=cullf, Splitters=mesh_2)

area_3 = MeshArea(Mesh=msplit_2)  # -> Area, Centroid
sort_3 = SortList(Keys=area_3.Area, ValuesA=msplit_2)  # -> Keys, ValuesA
item_6 = ListItem(List=sort_3.ValuesA, Index=0, Wrap=True)

geo_2 = Geometry(item_6)

# ---- group: clean up Border
wbnaked_2 = WeaverbirdsNakedBoundary(MeshClosedPolylines=cullf)
join = JoinCurves(Curves=wbnaked_2, Preserve=False)
len = Length(Curve=join)
rebcrvsegs = RebuildCurveSegments(EndTangents=False)  # -> Rebuilt, Amount, DegreesR, DegreesC, R
sort_4 = SortList(Keys=len, ValuesA=join)  # -> Keys, ValuesA
item_7 = ListItem(List=reverse(sort_4.ValuesA), Index=0, Wrap=True)
smoothpline = SmoothPolyline(Polyline=item_7, Strength=1, Times=Slider(5, range=0..10))
fitcrvsegs = FitCurveSegments(Curve=item_7, Search=Slider(23, range=0..100), DeviationTolerance=0.001)  # -> Fitted, Amount, DegreesF, DegreesC, R

# ---- group: WIP: Clean up first line of offset using projected crv
number_slider_2 = Slider(4, range=0..10)  # disabled
idist = Slider(4, range=0..10)  # disabled
c_script = CSharpScript(iMesh=geo_2, iCurve=crv_4, iCount=number_slider_2, iDist=idist)  # -> out, oCurves; inputs iMesh: Mesh, iCurve: Curve, iCount: Int32, iDist: Double; disabled
# ---------- c_script: C# ----------
    List<Curve> allCrvs = new List<Curve>();

    for(int i = 0; i < iCount; i++){
      if(i == 0){
        allCrvs.Add(OffsetCurve(iCurve, iMesh, iDist));}

      else {
        allCrvs.Add(OffsetCurve(allCrvs[i - 1], iMesh, iDist));}
    }


    oCurves = allCrvs;
# ---------- c_script: C# additional code ----------
  public Curve OffsetCurve(Curve crv, Mesh mesh, double dist){
    
    //project crv onto Mesh in neg Z direction
    var tol = RhinoDoc.ActiveDoc.ModelAbsoluteTolerance;
    Curve.ProjectToMesh(crv, mesh, Plane.WorldXY.ZAxis*-1, tol);

    Point3d[] points = crv.DivideEquidistant(10);
    points = mesh.PullPointsToMesh(points);
    Curve newCrv = Rhino.Geometry.Curve.CreateInterpolatedCurve(points, 3);
    newCrv.Domain = new Interval(0, 1);

    //List<Vector3d> tangents = new List<Vector3d>();
    //List<Vector3d> dirs = new List<Vector3d>();
    List<Point3d> MovedPts = new List<Point3d>();


    for(int i = 0; i < points.Length; i++){
      double param;
      Point3d pt;
      Vector3d normal;

      newCrv.ClosestPoint(points[i], out param);
      Vector3d tangent = newCrv.TangentAt(param);

      mesh.ClosestPoint(points[i], out pt, out normal, 10);
      Vector3d dir = Vector3d.CrossProduct(normal, tangent);
      dir.Unitize();
      Vector3d move = dir * dist;
      Point3d moved = Point3d.Add(move, points[i]);

      //tangents.Add(tangent);
      //dirs.Add(dir);
      MovedPts.Add(moved);
    }


    Curve offsetCrv = Rhino.Geometry.Curve.CreateInterpolatedCurve(MovedPts, 3);
    return offsetCrv;
  }
# ---------- end c_script ----------
c_script_2 = CSharpScript(iCrv=crv_4, iMesh=geo_2)  # -> out, A; inputs iCrv: Curve, iMesh: Mesh; disabled
# ---------- c_script_2: C# ----------
    var tol = RhinoDoc.ActiveDoc.ModelAbsoluteTolerance;
    Curve[] crv = Curve.ProjectToMesh(iCrv, iMesh, Plane.WorldXY.ZAxis*-1, tol);
    
    A = crv;
# ---------- end c_script_2 ----------
